# Grasshopper definition Foam_city.gh (Grasshopper 1.0.7)
# plug-ins: LunchBox, Human, MeshEdit Components

# ----
# CREATE BASE RECTANGLE
num_of_cells = Slider(18.9, range=1..40)
num_of_cells_2 = GetNumber(num_of_cells, AtLeast=1, AtMost=1, Maximum=1.797693135e+308, Minimum=-1.797693135e+308, TreeAccess=False)
rectangle = Rectangle(Plane=PlaneXY(0, 0, 0), XSize=Slider(100, range=0..100), YSize=Slider(100, range=0..100), Radius=0)  # -> Rectangle, Length
division = Division(A=num_of_cells_2, B=2)
hexagon_cells = HexagonCells(Surface=rectangle.Rectangle, UDivisions=num_of_cells_2, VDivisions=division, TParameter=Slider(0.33, range=0..1))  # -> HexagonCells, Centers
curve = Curve(hexagon_cells.HexagonCells)
context_bake = ContextBake(HexCurves=curve)

# ----
# CREATE RANDOM BUILDINGS
random_size = Slider(1000, range=0..1000)
building_scale = Slider(2, range=0..10)
random_seed = GetInteger(random_size, AtLeast=1, AtMost=1, Maximum=2147483647, Minimum=-2147483648, TreeAccess=False)
list_length = ListLength(List=hexagon_cells.HexagonCells)
building_scale_2 = GetNumber(building_scale, AtLeast=1, AtMost=1, Maximum=1.797693135e+308, Minimum=-1.797693135e+308, TreeAccess=False)
addition = Addition(A=building_scale_2, B=0.01)
random = Random(Range=Domain(0, 1), Number=list_length, Seed=random_seed)
division_2 = Division(A=addition, B=10)
unit_z = UnitZ(Factor=random)
center_box = CenterBox(Base=hexagon_cells.Centers, X=random, Y=random, Z=random)
one_over_x = OneOverX(Value=division_2)
move = Move(Geometry=center_box, Motion=unit_z)  # -> Geometry, Transform
mesh_area = MeshArea(Mesh=center_box)  # -> Area, Centroid
division_3 = Division(A=num_of_cells_2, B=one_over_x)
scale = Scale(Geometry=move.Geometry, Center=mesh_area.Centroid, Factor=division_3)  # -> Geometry, Transform
geometry = Geometry(scale.Geometry)
context_bake_2 = ContextBake(HexCurves=geometry)
custom_preview = CustomPreview(Geometry=geometry, Material=ColourSwatch(SwatchColor=RGBA(255, 0, 251, 38)))

# ----
# CREATE METABALLS BASED ON BUILDING VOLUME
number_slider = Slider(0, range=0..100)
construct_domain = ConstructDomain(DomainStart=number_slider, DomainEnd=Slider(10, range=0..100))
desire_to_be_indepedent = Slider(29.2, range=1..100)
range = Range(Domain=construct_domain, Steps=Slider(30, range=0..100))
volume = Volume(Geometry=geometry)  # -> Volume, Centroid
indepedence_level = GetNumber(desire_to_be_indepedent, AtLeast=1, AtMost=1, Maximum=1.797693135e+308, Minimum=-1.797693135e+308, TreeAccess=False)
construct_domain_2 = ConstructDomain(DomainStart=0, DomainEnd=1)
construct_point = ConstructPoint(XCoordinate=0, YCoordinate=0, ZCoordinate=range)
bounds = Bounds(Numbers=volume.Volume)
remap_numbers = RemapNumbers(Value=volume.Volume, Source=bounds, Target=construct_domain_2)  # -> Mapped, Clipped
division_4 = Division(A=indepedence_level, B=Slider(1000, range=0..1000))
plane_origin = PlaneOrigin(Base=construct_point, Origin=construct_point)
metaball_t_custom = MetaBallTCustom(Points=hexagon_cells.Centers, Charge=remap_numbers.Mapped, Plane=plane_origin, Threshold=division_4)
curve_2 = Curve(flatten(metaball_t_custom))
context_bake_3 = ContextBake(MetaballCurves=curve_2)
custom_preview_lineweights = CustomPreviewLineweights(Geometry=metaball_t_custom, Shader=ColourSwatch(SwatchColor=RGBA(0, 242, 255, 38)), Absolute=False)
